# Grasshopper definition Jiangyue Mao 1B-1.gh (Grasshopper 1.0.7)

x = Slider(2, range=0..2)
y = Slider(1, range=0..1)
x_2 = Slider(2, range=0..2)
x_3 = Slider(2, range=0..2)
tmin = Slider(6.3, range=0..6.3)
y_2 = Slider(1, range=0..1)
y_3 = Slider(1, range=0..1)
smin = Slider(6.3, range=0..6.3)
tmax = Slider(3.2, range=0..6.3)
xradius = Slider(2.3, range=1..20)
smax = Slider(3.2, range=0..6.3)
tmin_2 = Slider(6.3, range=0..6.3)
tmin_3 = Slider(6.3, range=0..6.3)
yradius = Slider(2.3, range=1..20)
smin_2 = Slider(6.3, range=0..6.3)
smin_3 = Slider(6.3, range=0..6.3)
tmax_2 = Slider(3.2, range=0..6.3)
xradius_2 = Slider(1, range=1..20)
tmax_3 = Slider(3.2, range=0..6.3)
xradius_3 = Slider(2.3, range=1..20)
xradius_4 = Slider(2.3, range=1..20)
yradius_2 = Slider(1, range=1..20)
smax_2 = Slider(3.2, range=0..6.3)
smax_3 = Slider(3.2, range=0..6.3)
yradius_3 = Slider(2.3, range=1..20)
x_4 = Slider(2, range=0..2)
yradius_4 = Slider(2.3, range=1..20)
y_4 = Slider(1, range=0..1)
xradius_5 = Slider(1, range=1..20)
xradius_6 = Slider(1, range=1..20)
yradius_5 = Slider(1, range=1..20)
yradius_6 = Slider(1, range=1..20)
tmin_4 = Slider(6.3, range=0..6.3)
smin_4 = Slider(6.3, range=0..6.3)
tmax_4 = Slider(3.2, range=0..6.3)
xradius_7 = Slider(2.3, range=1..20)
smax_4 = Slider(3.2, range=0..6.3)
yradius_7 = Slider(2.3, range=1..20)
xradius_8 = Slider(1, range=1..20)
yradius_8 = Slider(1, range=1..20)
xy_plane = XYPlane(Origin=Point(0, 0, 0))
xy_plane_2 = XYPlane(Origin=Point(0, 0, 0))
xy_plane_3 = XYPlane(Origin=Point(0, 0, 0))
xy_plane_4 = XYPlane(Origin=Point(0, 0, 0))
ghpython_script = GhPythonScript(
    plane=xy_plane,
    xRadius=xradius,
    yRadius=yradius,
    tMin=tmin,
    tMax=tmax,
    x=x,
    y=y,
    smin=smin,
    smax=smax,
    xradius=xradius_2,
    yradius=yradius_2)  # -> out, b, d, e, f, obj, obj1; inputs x: Int32, y: Int32
# ---------- ghpython_script: Python ----------
__author__ = "Jiangyue Mao"
__version__ = "2020.10.02"

import Rhino
import rhinoscriptsyntax as rs

# same code, but rotated
ellipse = Rhino.Geometry.Ellipse(plane, xRadius, yRadius)
if ellipse.IsValid:
    nurb = ellipse.ToNurbsCurve()
    if tMin != tMax:
        a = nurb.Trim(tMin, tMax)
    else:
        a = nurb
obj1=[]
for i in range(x):
    obj1.append(rs.MoveObject(a,[-xRadius+2.3+4.6*i,0,0]))

class Pill():
    def __init__(self,radius, posx,posy):
        self.radius=radius
        self.posx=posx
        self.posy=posy
    def draw(self):
        lines=[]
        for i in range(1,3):
            point_current=rs.CreatePoint(self.posx,self.posy,0)
            point_prev=rs.CreatePoint(self.posx+2*self.radius,self.posy,0)
            point_current1=rs.CreatePoint(self.posx,self.posy-self.radius,0)
            point_prev1=rs.CreatePoint(self.posx+2*self.radius,self.posy-self.radius,0)
            line=rs.AddLine(point_current1,point_prev1)
            line1=rs.AddLine(point_current1,point_current)
            line2=rs.AddLine(point_prev1,point_prev)
            lines.append(line1)
            lines.append(line2)
            lines.append(line)
        return lines
        

pills=[]
for i in range(x):
    for j in range(y):
        c=Pill(xRadius,-xRadius+4.6*i,5*j)
        pill=c.draw()
        for k in range(len(pill)):
            pills.append(pill[k])
b=pills

ellipse1 = Rhino.Geometry.Ellipse(plane, xradius, yradius)
if ellipse1.IsValid:
    nurb1 = ellipse1.ToNurbsCurve()
    if smin != smax:
        c = nurb1.Trim(smin,smax)
    else:
        c = nurb1
obj=[]
for i in range(x):
    obj.append(rs.MoveObject(c,[x-1+3.6*i,-1.3+1.3*i,0]))


pills1=[]
for i in range(x):
    for j in range(y):
        e=Pill(xradius,-xradius+1+4.6*i,-yradius-0.3+5*j)
        pill1=e.draw()
        for k in range(len(pill1)):
            pills1.append(pill1[k])
d=pills1

# rotate the whole object by 180 degrees 
rs.RotateObject(b,(xRadius,-yRadius,0),180)
rs.RotateObject(d,(xRadius,-yRadius,0),180)
rs.RotateObject(obj,(xRadius,-yRadius,0),180)
rs.RotateObject(obj1,(xRadius,-yRadius,0),180)
# ---------- end ghpython_script ----------
ghpython_script_2 = GhPythonScript(
    plane=xy_plane_3,
    xRadius=xradius_4,
    yRadius=yradius_4,
    tMin=tmin_3,
    tMax=tmax_3,
    x=x_3,
    y=y_3,
    smin=smin_3,
    smax=smax_3,
    xradius=xradius_6,
    yradius=yradius_6)  # -> out, b, d, e, f, obj, obj1; inputs x: Int32, y: Int32
# ---------- ghpython_script_2: Python ----------
__author__ = "Jiangyue Mao"
__version__ = "2020.10.02"

import Rhino
import rhinoscriptsyntax as rs

#create ellipse with the xy plane and xy radiuses
ellipse = Rhino.Geometry.Ellipse(plane, xRadius, yRadius)
# check if it is a valid shape, if it is, transform to nurbs
if ellipse.IsValid:
    nurb = ellipse.ToNurbsCurve()
    # trim out reduntant parts
    if tMin != tMax:
        a = nurb.Trim(tMin, tMax)
    else:
        a = nurb
        



# define class
class Pill():
    def __init__(self,radius, posx,posy):
        self.radius=radius
        self.posx=posx
        self.posy=posy
    def draw(self):
        lines=[]
        for i in range(1,3):
            # create points on upper and lower parts and connect them by lines
            point_current=rs.CreatePoint(self.posx,self.posy,0)
            point_prev=rs.CreatePoint(self.posx+2*self.radius,self.posy,0)
            point_current1=rs.CreatePoint(self.posx,self.posy-self.radius,0)
            point_prev1=rs.CreatePoint(self.posx+2*self.radius,self.posy-self.radius,0)
            line=rs.AddLine(point_current1,point_prev1)
            line1=rs.AddLine(point_current1,point_current)
            line2=rs.AddLine(point_prev1,point_prev)
            lines.append(line1)
            lines.append(line2)
            lines.append(line)
        return lines
        
        

pills=[]
# create lower part shape and duplicate it by 2
for i in range(x):
    for j in range(y):
        c=Pill(xRadius,-xRadius+4.6*i,5*j)
        pill=c.draw()
        for k in range(len(pill)):
            pills.append(pill[k])
b=pills

# move and append upper part shape 
obj1=[]
for i in range(x):
    obj1.append(rs.MoveObject(a,[-xRadius+2.3+4.6*i,0,0]))

# create smaller ellipses, same steps
ellipse1 = Rhino.Geometry.Ellipse(plane, xradius, yradius)
if ellipse1.IsValid:
    nurb1 = ellipse1.ToNurbsCurve()
    if smin != smax:
        c = nurb1.Trim(smin,smax)
    else:
        c = nurb1
        
# move and append smaller ellipse
obj=[]
for i in range(x):
    obj.append(rs.MoveObject(c,[1+3.6*i,-1.3+1.2*i%1.21,0]))

# create smaller lower part ellipse
pills1=[]
for i in range(x):
    for j in range(y):
        e=Pill(xradius,-xradius+1+4.6*i,-yradius-0.3+5*j)
        pill1=e.draw()
        for k in range(len(pill1)):
            pills1.append(pill1[k])
d=pills1
# ---------- end ghpython_script_2 ----------
ghpython_script_3 = GhPythonScript(
    plane=xy_plane_2,
    xRadius=xradius_3,
    yRadius=yradius_3,
    tMin=tmin_2,
    tMax=tmax_2,
    x=x_2,
    y=y_2,
    smin=smin_2,
    smax=smax_2,
    xradius=xradius_5,
    yradius=yradius_5)  # -> out, b, d, e, f, obj, obj1; inputs x: Int32, y: Int32
# ---------- ghpython_script_3: Python ----------
__author__ = "Jiangyue Mao"
__version__ = "2020.10.02"

import Rhino
import rhinoscriptsyntax as rs


ellipse = Rhino.Geometry.Ellipse(plane, xRadius, yRadius)
if ellipse.IsValid:
    nurb = ellipse.ToNurbsCurve()
    if tMin != tMax:
        a = nurb.Trim(tMin, tMax)
    else:
        a = nurb
obj1=[]
for i in range(x):
    obj1.append(rs.MoveObject(a,[-xRadius+2.3+4.6*i,0,0]))

class Pill():
    def __init__(self,radius, posx,posy):
        self.radius=radius
        self.posx=posx
        self.posy=posy
    def draw(self):
        lines=[]
        for i in range(1,3):
            point_current=rs.CreatePoint(self.posx,self.posy,0)
            point_prev=rs.CreatePoint(self.posx+2*self.radius,self.posy,0)
            point_current1=rs.CreatePoint(self.posx,self.posy-self.radius,0)
            point_prev1=rs.CreatePoint(self.posx+2*self.radius,self.posy-self.radius,0)
            line=rs.AddLine(point_current1,point_prev1)
            line1=rs.AddLine(point_current1,point_current)
            line2=rs.AddLine(point_prev1,point_prev)
            lines.append(line1)
            lines.append(line2)
            lines.append(line)
        return lines
        

pills=[]
for i in range(x):
    for j in range(y):
        c=Pill(xRadius,-xRadius+4.6*i,5*j)
        pill=c.draw()
        for k in range(len(pill)):
            pills.append(pill[k])
b=pills

ellipse1 = Rhino.Geometry.Ellipse(plane, xradius, yradius)
if ellipse1.IsValid:
    nurb1 = ellipse1.ToNurbsCurve()
    if smin != smax:
        c = nurb1.Trim(smin,smax)
    else:
        c = nurb1
obj=[]
for i in range(x):
    obj.append(rs.MoveObject(c,[x-1+3.6*i,-1.3+1.3*i,0]))


pills1=[]
for i in range(x):
    for j in range(y):
        e=Pill(xradius,-xradius+1+4.6*i,-yradius-0.3+5*j)
        pill1=e.draw()
        for k in range(len(pill1)):
            pills1.append(pill1[k])
d=pills1

rs.RotateObject(b,(xRadius,-yRadius-0.5,0),90)
rs.RotateObject(d,(xRadius,-yRadius-0.5,0),90)
rs.RotateObject(obj,(xRadius,-yRadius-0.5,0),90)
rs.RotateObject(obj1,(xRadius,-yRadius-0.5,0),90)

rs.MoveObject(b,(0.4,-8.7,0))
rs.MoveObject(d,(0.4,-8.7,0))
rs.MoveObject(obj,(0.4,-8.7,0))
rs.MoveObject(obj1,(0.4,-8.7,0))
# ---------- end ghpython_script_3 ----------
ghpython_script_4 = GhPythonScript(
    plane=xy_plane_4,
    xRadius=xradius_7,
    yRadius=yradius_7,
    tMin=tmin_4,
    tMax=tmax_4,
    x=x_4,
    y=y_4,
    smin=smin_4,
    smax=smax_4,
    xradius=xradius_8,
    yradius=yradius_8)  # -> out, b, d, e, f, obj, obj1; inputs x: Int32, y: Int32
# ---------- ghpython_script_4: Python ----------
__author__ = "Jiangyue Mao"
__version__ = "2020.10.02"

import Rhino
import rhinoscriptsyntax as rs


ellipse = Rhino.Geometry.Ellipse(plane, xRadius, yRadius)
if ellipse.IsValid:
    nurb = ellipse.ToNurbsCurve()
    if tMin != tMax:
        a = nurb.Trim(tMin, tMax)
    else:
        a = nurb
obj1=[]
for i in range(x):
    obj1.append(rs.MoveObject(a,[-xRadius+2.3+4.6*i,0,0]))

class Pill():
    def __init__(self,radius, posx,posy):
        self.radius=radius
        self.posx=posx
        self.posy=posy
    def draw(self):
        lines=[]
        for i in range(1,3):
            point_current=rs.CreatePoint(self.posx,self.posy,0)
            point_prev=rs.CreatePoint(self.posx+2*self.radius,self.posy,0)
            point_current1=rs.CreatePoint(self.posx,self.posy-self.radius,0)
            point_prev1=rs.CreatePoint(self.posx+2*self.radius,self.posy-self.radius,0)
            line=rs.AddLine(point_current1,point_prev1)
            line1=rs.AddLine(point_current1,point_current)
            line2=rs.AddLine(point_prev1,point_prev)
            lines.append(line1)
            lines.append(line2)
            lines.append(line)
        return lines
        

pills=[]
for i in range(x):
    for j in range(y):
        c=Pill(xRadius,-xRadius+4.6*i,5*j)
        pill=c.draw()
        for k in range(len(pill)):
            pills.append(pill[k])
b=pills

ellipse1 = Rhino.Geometry.Ellipse(plane, xradius, yradius)
if ellipse1.IsValid:
    nurb1 = ellipse1.ToNurbsCurve()
    if smin != smax:
        c = nurb1.Trim(smin,smax)
    else:
        c = nurb1
obj=[]
for i in range(x):
    obj.append(rs.MoveObject(c,[x-1+3.6*i,-1.3+1.3*i,0]))


pills1=[]
for i in range(x):
    for j in range(y):
        e=Pill(xradius,-xradius+1+4.6*i,-yradius-0.3+5*j)
        pill1=e.draw()
        for k in range(len(pill1)):
            pills1.append(pill1[k])
d=pills1

rs.RotateObject(b,(xRadius,-yRadius,0),180)
rs.RotateObject(d,(xRadius,-yRadius,0),180)
rs.RotateObject(obj,(xRadius,-yRadius,0),180)
rs.RotateObject(obj1,(xRadius,-yRadius,0),180)


rs.RotateObject(b,(xRadius,-yRadius-0.5,0),90)
rs.RotateObject(d,(xRadius,-yRadius-0.5,0),90)
rs.RotateObject(obj,(xRadius,-yRadius-0.5,0),90)
rs.RotateObject(obj1,(xRadius,-yRadius-0.5,0),90)

rs.MoveObject(b,(0.4,-8.7,0))
rs.MoveObject(d,(0.4,-8.7,0))
rs.MoveObject(obj,(0.4,-8.7,0))
rs.MoveObject(obj1,(0.4,-8.7,0))
# ---------- end ghpython_script_4 ----------
x_5 = Slider(2, range=0..2)
y_5 = Slider(1, range=0..1)
tmin_5 = Slider(6.3, range=0..6.3)
smin_5 = Slider(6.3, range=0..6.3)
tmax_5 = Slider(3.2, range=0..6.3)
xradius_9 = Slider(2.3, range=1..20)
smax_5 = Slider(3.2, range=0..6.3)
yradius_9 = Slider(2.3, range=1..20)
x_6 = Slider(2, range=0..2)
x_7 = Slider(2, range=0..2)
y_6 = Slider(1, range=0..1)
y_7 = Slider(1, range=0..1)
xradius_10 = Slider(1, range=1..20)
yradius_10 = Slider(1, range=1..20)
tmin_6 = Slider(6.3, range=0..6.3)
tmin_7 = Slider(6.3, range=0..6.3)
x_8 = Slider(2, range=0..2)
smin_6 = Slider(6.3, range=0..6.3)
y_8 = Slider(1, range=0..1)
smin_7 = Slider(6.3, range=0..6.3)
tmax_6 = Slider(3.2, range=0..6.3)
tmax_7 = Slider(3.2, range=0..6.3)
xradius_11 = Slider(2.3, range=1..20)
xradius_12 = Slider(2.3, range=1..20)
smax_6 = Slider(3.2, range=0..6.3)
smax_7 = Slider(3.2, range=0..6.3)
tmin_8 = Slider(6.3, range=0..6.3)
yradius_11 = Slider(2.3, range=1..20)
yradius_12 = Slider(2.3, range=1..20)
smin_8 = Slider(6.3, range=0..6.3)
xradius_13 = Slider(1, range=1..20)
xradius_14 = Slider(1, range=1..20)
tmax_8 = Slider(3.2, range=0..6.3)
xradius_15 = Slider(2.3, range=1..20)
yradius_13 = Slider(1, range=1..20)
yradius_14 = Slider(1, range=1..20)
smax_8 = Slider(3.2, range=0..6.3)
yradius_15 = Slider(2.3, range=1..20)
xradius_16 = Slider(1, range=1..20)
yradius_16 = Slider(1, range=1..20)
xy_plane_5 = XYPlane(Origin=Point(0, 0, 0))
xy_plane_6 = XYPlane(Origin=Point(0, 0, 0))
xy_plane_7 = XYPlane(Origin=Point(0, 0, 0))
xy_plane_8 = XYPlane(Origin=Point(0, 0, 0))
ghpython_script_5 = GhPythonScript(
    plane=xy_plane_5,
    xRadius=xradius_9,
    yRadius=yradius_9,
    tMin=tmin_5,
    tMax=tmax_5,
    x=x_5,
    y=y_5,
    smin=smin_5,
    smax=smax_5,
    xradius=xradius_10,
    yradius=yradius_10)  # -> out, b, d, e, f, obj, obj1; inputs x: Int32, y: Int32
# ---------- ghpython_script_5: Python ----------
__author__ = "Jiangyue Mao"
__version__ = "2020.10.02"

import Rhino
import rhinoscriptsyntax as rs

# same code as before, duplicate the shapes, rotate and move
ellipse = Rhino.Geometry.Ellipse(plane, xRadius, yRadius)
if ellipse.IsValid:
    nurb = ellipse.ToNurbsCurve()
    if tMin != tMax:
        a = nurb.Trim(tMin, tMax)
    else:
        a = nurb
obj1=[]
for i in range(x):
    obj1.append(rs.MoveObject(a,[-xRadius+2.3+4.6*i,0,0]))

class Pill():
    def __init__(self,radius, posx,posy):
        self.radius=radius
        self.posx=posx
        self.posy=posy
    def draw(self):
        lines=[]
        for i in range(1,3):
            point_current=rs.CreatePoint(self.posx,self.posy,0)
            point_prev=rs.CreatePoint(self.posx+2*self.radius,self.posy,0)
            point_current1=rs.CreatePoint(self.posx,self.posy-self.radius,0)
            point_prev1=rs.CreatePoint(self.posx+2*self.radius,self.posy-self.radius,0)
            line=rs.AddLine(point_current1,point_prev1)
            line1=rs.AddLine(point_current1,point_current)
            line2=rs.AddLine(point_prev1,point_prev)
            lines.append(line1)
            lines.append(line2)
            lines.append(line)
        return lines
        

pills=[]
for i in range(x):
    for j in range(y):
        c=Pill(xRadius,-xRadius+4.6*i,5*j)
        pill=c.draw()
        for k in range(len(pill)):
            pills.append(pill[k])
b=pills

ellipse1 = Rhino.Geometry.Ellipse(plane, xradius, yradius)
if ellipse1.IsValid:
    nurb1 = ellipse1.ToNurbsCurve()
    if smin != smax:
        c = nurb1.Trim(smin,smax)
    else:
        c = nurb1
obj=[]
for i in range(x):
    obj.append(rs.MoveObject(c,[x-1+3.6*i,-1.3+1.3*i,0]))


pills1=[]
for i in range(x):
    for j in range(y):
        e=Pill(xradius,-xradius+1+4.6*i,-yradius-0.3+5*j)
        pill1=e.draw()
        for k in range(len(pill1)):
            pills1.append(pill1[k])
d=pills1

# rotate the whole object by 90 degrees and move it to the side
rs.RotateObject(b,(xRadius,-yRadius-0.5,0),90)
rs.RotateObject(d,(xRadius,-yRadius-0.5,0),90)
rs.RotateObject(obj,(xRadius,-yRadius-0.5,0),90)
rs.RotateObject(obj1,(xRadius,-yRadius-0.5,0),90)

rs.MoveObject(b,(9.7,0.4,0))
rs.MoveObject(d,(9.7,0.4,0))
rs.MoveObject(obj,(9.7,0.4,0))
rs.MoveObject(obj1,(9.7,0.4,0))
# ---------- end ghpython_script_5 ----------
ghpython_script_6 = GhPythonScript(
    plane=xy_plane_6,
    xRadius=xradius_11,
    yRadius=yradius_11,
    tMin=tmin_6,
    tMax=tmax_6,
    x=x_6,
    y=y_6,
    smin=smin_6,
    smax=smax_6,
    xradius=xradius_13,
    yradius=yradius_13)  # -> out, b, d, e, f, obj, obj1; inputs x: Int32, y: Int32
# ---------- ghpython_script_6: Python ----------
__author__ = "Jiangyue Mao"
__version__ = "2020.10.02"

import Rhino
import rhinoscriptsyntax as rs

# same code, rotated and moved
ellipse = Rhino.Geometry.Ellipse(plane, xRadius, yRadius)
if ellipse.IsValid:
    nurb = ellipse.ToNurbsCurve()
    if tMin != tMax:
        a = nurb.Trim(tMin, tMax)
    else:
        a = nurb
obj1=[]
for i in range(x):
    obj1.append(rs.MoveObject(a,[-xRadius+2.3+4.6*i,0,0]))

class Pill():
    def __init__(self,radius, posx,posy):
        self.radius=radius
        self.posx=posx
        self.posy=posy
    def draw(self):
        lines=[]
        for i in range(1,3):
            point_current=rs.CreatePoint(self.posx,self.posy,0)
            point_prev=rs.CreatePoint(self.posx+2*self.radius,self.posy,0)
            point_current1=rs.CreatePoint(self.posx,self.posy-self.radius,0)
            point_prev1=rs.CreatePoint(self.posx+2*self.radius,self.posy-self.radius,0)
            line=rs.AddLine(point_current1,point_prev1)
            line1=rs.AddLine(point_current1,point_current)
            line2=rs.AddLine(point_prev1,point_prev)
            lines.append(line1)
            lines.append(line2)
            lines.append(line)
        return lines
        

pills=[]
for i in range(x):
    for j in range(y):
        c=Pill(xRadius,-xRadius+4.6*i,5*j)
        pill=c.draw()
        for k in range(len(pill)):
            pills.append(pill[k])
b=pills

ellipse1 = Rhino.Geometry.Ellipse(plane, xradius, yradius)
if ellipse1.IsValid:
    nurb1 = ellipse1.ToNurbsCurve()
    if smin != smax:
        c = nurb1.Trim(smin,smax)
    else:
        c = nurb1
obj=[]
for i in range(x):
    obj.append(rs.MoveObject(c,[x-1+3.6*i,-1.3+1.3*i,0]))


pills1=[]
for i in range(x):
    for j in range(y):
        e=Pill(xradius,-xradius+1+4.6*i,-yradius-0.3+5*j)
        pill1=e.draw()
        for k in range(len(pill1)):
            pills1.append(pill1[k])
d=pills1


# rotate the whole object by 180 degrees first and then rotate 90 degrees and move it to the side
rs.RotateObject(b,(xRadius,-yRadius,0),180)
rs.RotateObject(d,(xRadius,-yRadius,0),180)
rs.RotateObject(obj,(xRadius,-yRadius,0),180)
rs.RotateObject(obj1,(xRadius,-yRadius,0),180)


rs.RotateObject(b,(xRadius,-yRadius-0.5,0),90)
rs.RotateObject(d,(xRadius,-yRadius-0.5,0),90)
rs.RotateObject(obj,(xRadius,-yRadius-0.5,0),90)
rs.RotateObject(obj1,(xRadius,-yRadius-0.5,0),90)

rs.MoveObject(b,(9.7,0.4,0))
rs.MoveObject(d,(9.7,0.4,0))
rs.MoveObject(obj,(9.7,0.4,0))
rs.MoveObject(obj1,(9.7,0.4,0))
# ---------- end ghpython_script_6 ----------
ghpython_script_7 = GhPythonScript(
    plane=xy_plane_7,
    xRadius=xradius_12,
    yRadius=yradius_12,
    tMin=tmin_7,
    tMax=tmax_7,
    x=x_7,
    y=y_7,
    smin=smin_7,
    smax=smax_7,
    xradius=xradius_14,
    yradius=yradius_14)  # -> out, b, d, e, f, obj, obj1; inputs x: Int32, y: Int32
# ---------- ghpython_script_7: Python ----------
__author__ = "Jiangyue Mao"
__version__ = "2020.10.02"

import Rhino
import rhinoscriptsyntax as rs


ellipse = Rhino.Geometry.Ellipse(plane, xRadius, yRadius)
if ellipse.IsValid:
    nurb = ellipse.ToNurbsCurve()
    if tMin != tMax:
        a = nurb.Trim(tMin, tMax)
    else:
        a = nurb
obj1=[]
for i in range(x):
    obj1.append(rs.MoveObject(a,[-xRadius+2.3+4.6*i,0,0]))

class Pill():
    def __init__(self,radius, posx,posy):
        self.radius=radius
        self.posx=posx
        self.posy=posy
    def draw(self):
        lines=[]
        for i in range(1,3):
            point_current=rs.CreatePoint(self.posx,self.posy,0)
            point_prev=rs.CreatePoint(self.posx+2*self.radius,self.posy,0)
            point_current1=rs.CreatePoint(self.posx,self.posy-self.radius,0)
            point_prev1=rs.CreatePoint(self.posx+2*self.radius,self.posy-self.radius,0)
            line=rs.AddLine(point_current1,point_prev1)
            line1=rs.AddLine(point_current1,point_current)
            line2=rs.AddLine(point_prev1,point_prev)
            lines.append(line1)
            lines.append(line2)
            lines.append(line)
        return lines
        

pills=[]
for i in range(x):
    for j in range(y):
        c=Pill(xRadius,-xRadius+4.6*i,5*j)
        pill=c.draw()
        for k in range(len(pill)):
            pills.append(pill[k])
b=pills

ellipse1 = Rhino.Geometry.Ellipse(plane, xradius, yradius)
if ellipse1.IsValid:
    nurb1 = ellipse1.ToNurbsCurve()
    if smin != smax:
        c = nurb1.Trim(smin,smax)
    else:
        c = nurb1
obj=[]
for i in range(x):
    obj.append(rs.MoveObject(c,[x-1+3.6*i,-1.3+1.3*i,0]))


pills1=[]
for i in range(x):
    for j in range(y):
        e=Pill(xradius,-xradius+1+4.6*i,-yradius-0.3+5*j)
        pill1=e.draw()
        for k in range(len(pill1)):
            pills1.append(pill1[k])
d=pills1

rs.RotateObject(b,(xRadius,-yRadius,0),180)
rs.RotateObject(d,(xRadius,-yRadius,0),180)
rs.RotateObject(obj,(xRadius,-yRadius,0),180)
rs.RotateObject(obj1,(xRadius,-yRadius,0),180)


rs.MoveObject(b,(9.1,-9.3,0))
rs.MoveObject(d,(9.1,-9.3,0))
rs.MoveObject(obj,(9.1,-9.3,0))
rs.MoveObject(obj1,(9.1,-9.3,0))
# ---------- end ghpython_script_7 ----------
ghpython_script_8 = GhPythonScript(
    plane=xy_plane_8,
    xRadius=xradius_15,
    yRadius=yradius_15,
    tMin=tmin_8,
    tMax=tmax_8,
    x=x_8,
    y=y_8,
    smin=smin_8,
    smax=smax_8,
    xradius=xradius_16,
    yradius=yradius_16)  # -> out, b, d, e, f, obj, obj1; inputs x: Int32, y: Int32
# ---------- ghpython_script_8: Python ----------
__author__ = "Jiangyue Mao"
__version__ = "2020.10.02"

import Rhino
import rhinoscriptsyntax as rs


ellipse = Rhino.Geometry.Ellipse(plane, xRadius, yRadius)
if ellipse.IsValid:
    nurb = ellipse.ToNurbsCurve()
    if tMin != tMax:
        a = nurb.Trim(tMin, tMax)
    else:
        a = nurb
obj1=[]
for i in range(x):
    obj1.append(rs.MoveObject(a,[-xRadius+2.3+4.6*i,0,0]))

class Pill():
    def __init__(self,radius, posx,posy):
        self.radius=radius
        self.posx=posx
        self.posy=posy
    def draw(self):
        lines=[]
        for i in range(1,3):
            point_current=rs.CreatePoint(self.posx,self.posy,0)
            point_prev=rs.CreatePoint(self.posx+2*self.radius,self.posy,0)
            point_current1=rs.CreatePoint(self.posx,self.posy-self.radius,0)
            point_prev1=rs.CreatePoint(self.posx+2*self.radius,self.posy-self.radius,0)
            line=rs.AddLine(point_current1,point_prev1)
            line1=rs.AddLine(point_current1,point_current)
            line2=rs.AddLine(point_prev1,point_prev)
            lines.append(line1)
            lines.append(line2)
            lines.append(line)
        return lines
        

pills=[]
for i in range(x):
    for j in range(y):
        c=Pill(xRadius,-xRadius+4.6*i,5*j)
        pill=c.draw()
        for k in range(len(pill)):
            pills.append(pill[k])
b=pills

ellipse1 = Rhino.Geometry.Ellipse(plane, xradius, yradius)
if ellipse1.IsValid:
    nurb1 = ellipse1.ToNurbsCurve()
    if smin != smax:
        c = nurb1.Trim(smin,smax)
    else:
        c = nurb1
obj=[]
for i in range(x):
    obj.append(rs.MoveObject(c,[x-1+3.6*i,-1.3+1.3*i,0]))


pills1=[]
for i in range(x):
    for j in range(y):
        e=Pill(xradius,-xradius+1+4.6*i,-yradius-0.3+5*j)
        pill1=e.draw()
        for k in range(len(pill1)):
            pills1.append(pill1[k])
d=pills1

rs.MoveObject(b,(9.1,-9.3,0))
rs.MoveObject(d,(9.1,-9.3,0))
rs.MoveObject(obj,(9.1,-9.3,0))
rs.MoveObject(obj1,(9.1,-9.3,0))
# ---------- end ghpython_script_8 ----------
