# Grasshopper definition Jiangyue Mao A2.gh (Grasshopper 1.0.7)
# plug-ins: LunchBoxML, Firefly.Core

open_close_port = OpenClosePort(OpenClosePort=Toggle(False), PortNumber="5", BaudRate="9600")
serial_read_generic = SerialReadGeneric(StartReadingValues=Toggle(True), PortNumber="5")  # -> SerialOutput, StatusMessage
timer = Timer(TimerInterval=200, Target=serial_read_generic)
panel = Panel(open_close_port)
panel_2 = Panel(serial_read_generic.SerialOutput)
division = Division(A="54", B=10)
panel_3 = Panel(serial_read_generic.StatusMessage)
number_slider = Slider(0, range=0..100)
round = Round(Number=division)  # -> Nearest, Floor, Ceiling
multiplication = Multiplication(A=round.Floor, B=Slider(9, range=0..10))
ghpython_script = GhPythonScript(x=round.Floor)  # -> a, spheres; inputs x: Int32
# ---------- ghpython_script: Python ----------
__author__ = "Mao Jiangyue"
__version__ = "2020.09.23"

import rhinoscriptsyntax as rs
import Rhino.Geometry as rg

# set up empty lists
points=[]
spheres=[]

# run loop and create points in 3d space in the shape of box
for i in range(x):
    for y in range(x):
        for z in range(x):
            point=rg.Point3d(i,y,z)
            points.append(point)
            sphere=rs.AddSphere(point,0.5)
            spheres.append(sphere)

a=points
# ---------- end ghpython_script ----------

# ---- group: make the poins form a box, and the size of box changes by how large the data numbe
closest_points = ClosestPoints(Point=ghpython_script.a, Cloud=ghpython_script.a, Count=Slider(4, range=0..10))  # -> ClosestPoint, CPIndex, Distance
bounding_box = BoundingBox(Content=closest_points.ClosestPoint, Plane=PlaneXY(0, 0, 0))  # -> Box, Box_2
deconstruct_box = DeconstructBox(Box=bounding_box.Box)  # -> Plane, X, Y, Z
deconstruct_domain = DeconstructDomain(Domain=deconstruct_box.X)  # -> Start, End
deconstruct_domain_2 = DeconstructDomain(Domain=deconstruct_box.Z)  # -> Start, End
deconstruct_domain_3 = DeconstructDomain(Domain=deconstruct_box.Y)  # -> Start, End
subtraction = Subtraction(A=deconstruct_domain.End, B=deconstruct_domain.Start)
subtraction_2 = Subtraction(A=deconstruct_domain_3.End, B=deconstruct_domain_3.Start)
subtraction_3 = Subtraction(A=deconstruct_domain_2.End, B=deconstruct_domain_2.Start)
merge = Merge(Data1=subtraction, Data2=subtraction_2, Data3=subtraction_3)
k_means_clustering = KMeansClustering(TrainingInputs=merge, OfClusters=Slider(2, range=0..10), RandomSeed=5)  # -> Result, Likelihood, Centroids
create_set = CreateSet(List=k_means_clustering.Result)  # -> Set, Map
number_slider_2 = Slider(255, range=0..1000)
list_length = ListLength(List=create_set.Set)
gradient = Gradient(
    LowerLimit=0,
    UpperLimit=list_length,
    Parameter=create_set.Map,
    stops=[0: RGB(243, 57, 0), 0.0281: RGB(210, 0, 118), 0.032: RGB(236, 27, 60), 0.067: RGB(103, 0, 120), 0.253: RGB(39, 72, 161), 0.46: RGB(1, 192, 229), 0.6: RGB(18, 178, 90), 0.607: RGB(79, 186, 8), 0.829: RGB(220, 237, 32), 0.984: RGB(247, 159, 20), 1: RGB(243, 57, 0)])
split_argb = SplitARGB(Colour=gradient)  # -> Alpha, Red, Green, Blue
colour_rgb = ColourRGB(Alpha=Slider(255, range=0..1000), Red=split_argb.Red, Green=split_argb.Green, Blue=split_argb.Blue)
custom_preview = CustomPreview(Geometry=ghpython_script.a, Material=colour_rgb)

# ----
unit_z = UnitZ(Factor=1)
construct_point = ConstructPoint(XCoordinate=number_slider, YCoordinate=number_slider, ZCoordinate=number_slider)

# ---- group: rotate by the angle same as input data
rotate_3d = Rotate3D(Geometry=ghpython_script.a, Angle=degrees(multiplication), Center=Point(0, 0, 0), Axis=unit_z)  # -> Geometry, Transform
colour_hsl = ColourHSL(
    Alpha=Slider(0.832, range=0..1),
    Hue=Slider(7.545, range=0..10),
    Saturation=Slider(0.866, range=0..1),
    Luminance=Slider(0.733, range=0..1))
custom_preview_2 = CustomPreview(Geometry=ghpython_script.spheres, Material=colour_hsl)
colour_hsl_2 = ColourHSL(
    Alpha=Slider(0.846, range=0..1),
    Hue=Slider(6.834, range=0..10),
    Saturation=Slider(0.819, range=0..1),
    Luminance=Slider(0.845, range=0..1))
cone = Cone(Base=rotate_3d.Geometry, Radius=Slider(0.718, range=0..1), Length=1)  # -> Cone, Tip
custom_preview_3 = CustomPreview(Geometry=cone.Cone, Material=colour_hsl_2)
